# Dynamo graph BachelorThesis.dyn (Dynamo 2.6.1.8786)
# packages: Celery for Dynamo 2.5 20.6.7

# group: Building Class List Create
string = StringInput("Building Class 1 (Freestanding/Agricultural/Forestry)")
string_2 = StringInput("Building Class 2")
string_3 = StringInput("Building Class 3")
string_4 = StringInput("Building Class 4")
string_5 = StringInput("Building Class 5")
list_create = List.Create(item0=string, item1=string_2, item2=string_3, item3=string_4, item4=string_5)

# group: Rules
number = DoubleInput(1)
floorTypesList = Python()
# ---------- floorTypesList.python (20 lines) ----------
#import relevant libraries
import clr
clr.AddReference('RevitNodes')
import Revit
clr.ImportExtensions(Revit.Elements)
clr.AddReference('RevitServices')
import RevitServices
from RevitServices.Persistence import DocumentManager
clr.AddReference('RevitAPI')
import Autodesk
from Autodesk.Revit.DB import *
import System
from System.Collections.Generic import *

#Collect and output all wall types
doc = DocumentManager.Instance.CurrentDBDocument

collectedFloorTypes = FilteredElementCollector(doc).OfCategory(BuiltInCategory.OST_Floors).WhereElementIsElementType().ToElements()

OUT = collectedFloorTypes
# ----------------------------------------
string_6 = StringInput("Description")
parameterByName = Parameter.ParameterByName(element=floorTypesList, name=string_6)
value = Parameter.Value(parameter=parameterByName)
wallTypesList = Python()
# ---------- wallTypesList.python (20 lines) ----------
#import relevant libraries
import clr
clr.AddReference('RevitNodes')
import Revit
clr.ImportExtensions(Revit.Elements)
clr.AddReference('RevitServices')
import RevitServices
from RevitServices.Persistence import DocumentManager
clr.AddReference('RevitAPI')
import Autodesk
from Autodesk.Revit.DB import *
import System
from System.Collections.Generic import *

#Collect and output all wall types
doc = DocumentManager.Instance.CurrentDBDocument

collectedWallTypes = FilteredElementCollector(doc).OfCategory(BuiltInCategory.OST_Walls).WhereElementIsElementType().ToElements()

OUT = collectedWallTypes
# ----------------------------------------
string_7 = StringInput("Fire Rating")
parameterByName_2 = Parameter.ParameterByName(element=wallTypesList, name=string_7)
value_2 = Parameter.Value(parameter=parameterByName_2)
number_2 = DoubleInput(5)

# group: Parameter Input
buildingClass = ListItemSelectorX(index=4, list=list_create)
levelheight_m = DoubleSlider(3, range=2.8..4 step 0.1)
basement = BoolSelector(true)
freestanding = BoolSelector(false)
agricultural_forestry = BoolSelector(false)

# group (continued): Rules
building_class_to_integer = Python(IN[0]=buildingClass)
# ---------- building_class_to_integer.python (22 lines) ----------
#Load the Python Standard and DesignScript Libraries
import sys
import clr
clr.AddReference('ProtoGeometry')
from Autodesk.DesignScript.Geometry import *

#Assign input to variables
buildingClassString = IN[0]

#Convert building class string to integer
if buildingClassString == "Building Class 1 (Freestanding/Agricultural/Forestry)":
    buildingClass = 1
if buildingClassString == "Building Class 2":
    buildingClass = 2
if buildingClassString == "Building Class 3":
    buildingClass = 3
if buildingClassString == "Building Class 4":
    buildingClass = 4
if buildingClassString == "Building Class 5":
    buildingClass = 5

OUT = int(buildingClass)
# ----------------------------------------
maxLevels = Python(IN[0]=building_class_to_integer, IN[1]=levelheight_m)
# ---------- maxLevels.python (20 lines) ----------
#Load the Python Standard and DesignScript Libraries and Math
import sys
import clr
clr.AddReference('ProtoGeometry')
from Autodesk.DesignScript.Geometry import *
import math

#Assign input to variables
buildingClass = IN[0]
levelHeight = IN[1]

#Determine and output maxLevels
if buildingClass == 1 or buildingClass == 2 or buildingClass == 3:
    maxLevels = math.floor(7 / levelHeight) + 1
if buildingClass == 4:
    maxLevels = math.floor(13 / levelHeight) + 1
if buildingClass == 5:
    maxLevels = 10
	
OUT = maxLevels	
# ----------------------------------------
floorTypesFilter = Python(IN[0]=value, IN[1]=floorTypesList, IN[2]=building_class_to_integer)
# ---------- floorTypesFilter.python (37 lines) ----------
#Load the Python Standard and DesignScript Libraries
import sys
import clr
clr.AddReference('ProtoGeometry')
from Autodesk.DesignScript.Geometry import *

#Assign input to variables
descriptions = IN[0]
collectedFloorTypes = IN[1]
buildingClass = IN[2]

#Filter floor types dependent on building class
floorTypes = []

if buildingClass == 1:
    for i in range(0, len(descriptions)):
        floorTypes.append(collectedFloorTypes[i].Name)

if buildingClass == 2 or buildingClass == 3:
    for i in range(0, len(descriptions)):
        if (descriptions[i] == "fire retarding"
            or descriptions[i] == "highly fire retarding"
            or descriptions[i] == "fire resisting"):
            floorTypes.append(collectedFloorTypes[i].Name)
            
if buildingClass == 4:
    for i in range(0, len(descriptions)):
        if (descriptions[i] == "highly fire retarding"
            or descriptions[i] == "fire resisting"):
            floorTypes.append(collectedFloorTypes[i].Name)

if buildingClass == 5:
    for i in range(0, len(descriptions)):
        if descriptions[i] == "fire resisting":
            floorTypes.append(collectedFloorTypes[i].Name)
            
OUT = floorTypes
# ----------------------------------------
wallTypesFilter = Python(IN[0]=value_2, IN[1]=wallTypesList, IN[2]=building_class_to_integer)
# ---------- wallTypesFilter.python (37 lines) ----------
#Load the Python Standard and DesignScript Libraries
import sys
import clr
clr.AddReference('ProtoGeometry')
from Autodesk.DesignScript.Geometry import *

#Assign input to variables
fireRatings = IN[0]
collectedWallTypes = IN[1]
buildingClass = IN[2]

#Filter wall types dependent on building class
wallTypeNames = []

if buildingClass == 1:
    for i in range(0, len(fireRatings)):
        wallTypeNames.append(collectedWallTypes[i].Name)

if buildingClass == 2 or buildingClass == 3:
    for i in range(0, len(fireRatings)):
        if (fireRatings[i] == "fire retarding"
            or fireRatings[i] == "highly fire retarding"
            or fireRatings[i] == "fire resisting"):
            wallTypeNames.append(collectedWallTypes[i].Name)

if buildingClass == 4:
    for i in range(0, len(fireRatings)):
        if (fireRatings[i] == "highly fire retarding"
            or fireRatings[i] == "fire resisting"):
            wallTypeNames.append(collectedWallTypes[i].Name)

if buildingClass == 5:
    for i in range(0, len(fireRatings)):
        if fireRatings[i] == "fire resisting":
            wallTypeNames.append(collectedWallTypes[i].Name)

OUT = wallTypeNames
# ----------------------------------------
maxUnits = Python(IN[0]=building_class_to_integer)
# ---------- maxUnits.python (16 lines) ----------
#Load the Python Standard and DesignScript Libraries
import sys
import clr
clr.AddReference('ProtoGeometry')
from Autodesk.DesignScript.Geometry import *

#Assign input to variables
buildingClass = IN[0]

#Determine and output maxUtilizationUnits
if buildingClass == 1 or buildingClass == 2:
    maxUtilizationUnits = 2
if buildingClass == 3 or buildingClass == 4 or buildingClass == 5:
    maxUtilizationUnits = 100
	
OUT = maxUtilizationUnits
# ----------------------------------------
basementCeilingFilter = Python(IN[0]=value, IN[1]=floorTypesList, IN[2]=building_class_to_integer, IN[3]=basement)
# ---------- basementCeilingFilter.python (29 lines) ----------
#Load the Python Standard and DesignScript Libraries
import sys
import clr
clr.AddReference('ProtoGeometry')
from Autodesk.DesignScript.Geometry import *

#Assign input to variables
descriptions = IN[0]
collectedFloorTypes = IN[1]
buildingClass = IN[2]
basement = IN[3]

#Filter floor types dependent on building class
basementCeilings = []

if basement:
    if buildingClass == 1 or buildingClass == 2:
        for i in range(0, len(descriptions)):
            if (descriptions[i] == "fire retarding"
            or descriptions[i] == "highly fire retarding"
            or descriptions[i] == "fire resisting"):
                basementCeilings.append(collectedFloorTypes[i].Name)
                
    if buildingClass == 3 or buildingClass == 4 or buildingClass == 5:
        for i in range(0, len(descriptions)):
            if descriptions[i] == "fire resisting":
                basementCeilings.append(collectedFloorTypes[i].Name)
            
OUT = basementCeilings
# ----------------------------------------

# group (continued): Parameter Input
levels = InputBoundedNumberSlider(leftLimit=number, rightLimit=maxLevels, IsDeserialized=false, SliderPrecision=1, InitialPrecision=3, PrecisionCollection=[1, 2, 3, 4, 5, 6, 7, 8, 9, 10], SliderValue=237.9500178, IsInteger=true)
floorType = ListItemSelectorX(index=0, list=floorTypesFilter, Items=[{Name: "fire resisting Generic Floor - 400mm", Item: {ConcreteType: "ProtoCore.Mirror.MirrorData, ProtoCore", Class: null, StringData: "fire resisting Generic Floor - 400mm", Data: "fire resisting Generic Floor - 400mm", IsNull: false, IsCollection: false, IsDictionary: false, IsPointer: false}}])
wallType = ListItemSelectorX(index=0, list=wallTypesFilter, Items=[{Name: "fire resisting Generic - 300mm", Item: {ConcreteType: "ProtoCore.Mirror.MirrorData, ProtoCore", Class: null, StringData: "fire resisting Generic - 300mm", Data: "fire resisting Generic - 300mm", IsNull: false, IsCollection: false, IsDictionary: false, IsPointer: false}}])
utilizationUnits = InputBoundedNumberSlider(leftLimit=number, rightLimit=maxUnits, IsDeserialized=false, SliderPrecision=1, InitialPrecision=3, PrecisionCollection=[1, 2, 3, 4, 5, 6, 7, 8, 9, 10], SliderValue=70.74262608, IsInteger=true)
basementCeiling = ListItemSelectorX(index=0, list=basementCeilingFilter, Items=[{Name: "fire resisting Generic Floor - 400mm", Item: {ConcreteType: "ProtoCore.Mirror.MirrorData, ProtoCore", Class: null, StringData: "fire resisting Generic Floor - 400mm", Data: "fire resisting Generic Floor - 400mm", IsNull: false, IsCollection: false, IsDictionary: false, IsPointer: false}}])

# group: Transform
byName = FloorType.ByName(name=floorType)
byName_2 = WallType.ByName(name=wallType)
byName_3 = FloorType.ByName(name=basementCeiling)

# group (continued): Rules
rightLimitX = Python(IN[0]=building_class_to_integer, IN[1]=levels, IN[2]=utilizationUnits)
# ---------- rightLimitX.python (21 lines) ----------
#Load the Python Standard and DesignScript Libraries and Math
import sys
import clr
clr.AddReference('ProtoGeometry')
from Autodesk.DesignScript.Geometry import *
import math

#Assign input to variables
buildingClass = IN[0]
levels = IN[1]
utilizationUnits = IN[2]

#Determine and output rightLimitX
if buildingClass == 1 or buildingClass == 2:
    rightLimitX = math.floor(80 / levels)
if buildingClass == 3 or buildingClass == 5:
    rightLimitX = 200
if buildingClass == 4:
    rightLimitX = math.floor(80 / levels * utilizationUnits)
	
OUT = rightLimitX
# ----------------------------------------

# group (continued): Parameter Input
x_m = InputBoundedNumberSlider(leftLimit=number_2, rightLimit=rightLimitX, IsDeserialized=false, SliderPrecision=1, InitialPrecision=3, PrecisionCollection=[1, 2, 3, 4, 5, 6, 7, 8, 9, 10], SliderValue=90.22070427, IsInteger=true)

# group (continued): Rules
rightLimitY = Python(IN[0]=building_class_to_integer, IN[1]=levels, IN[2]=utilizationUnits, IN[3]=x_m)
# ---------- rightLimitY.python (22 lines) ----------
#Load the Python Standard and DesignScript Libraries and Math
import sys
import clr
clr.AddReference('ProtoGeometry')
from Autodesk.DesignScript.Geometry import *
import math

#Assign input to variables
buildingClass = IN[0]
levels = IN[1]
utilizationUnits = IN[2]
x = IN[3]

#Determine and output rightLimitY
if buildingClass == 1 or buildingClass == 2:
    rightLimitY = math.floor(400 / levels / x)
if buildingClass == 3 or buildingClass == 5:
    rightLimitY = 200
if buildingClass == 4:
    rightLimitY = math.floor(400 / x / levels * utilizationUnits)
	
OUT = rightLimitY
# ----------------------------------------

# group (continued): Parameter Input
y_m = InputBoundedNumberSlider(leftLimit=number_2, rightLimit=rightLimitY, IsDeserialized=false, SliderPrecision=1, InitialPrecision=3, PrecisionCollection=[1, 2, 3, 4, 5, 6, 7, 8, 9, 10], SliderValue=51.50301731, IsInteger=true)

# group: Model Creation
clear = BoolSelector(true)
levels_2 = Levels("Level 1")
all_elements_at_level = ElementsAtLevel(Level=levels_2)
model_creation = Python(IN[0]=levels, IN[1]=levelheight_m, IN[2]=byName, IN[3]=clear, IN[4]=all_elements_at_level, IN[5]=levels_2, IN[6]=byName_2, IN[7]=x_m, IN[8]=y_m, IN[9]=utilizationUnits, IN[10]=basement, IN[11]=byName_3)
# ---------- model_creation.python (228 lines) ----------
#Load the Python Standard and DesignScript Libraries and Math
import sys
import clr
clr.AddReference('ProtoGeometry')
from Autodesk.DesignScript.Geometry import *
import math

#Import Revit Nodes
clr.AddReference("RevitNodes")
from Revit.Elements import *
import Revit
clr.ImportExtensions(Revit.Elements)
clr.ImportExtensions(Revit.GeometryConversion)

#Import RevitAPI
clr.AddReference("RevitAPI")
import Autodesk
from Autodesk.Revit.DB import *
from Autodesk.Revit.DB import StairsEditScope
from Autodesk.Revit.DB import Parameter
from Autodesk.Revit.DB.Architecture import StairsRun
from Autodesk.Revit.DB.Architecture import *
from Autodesk.Revit.DB import IFailuresPreprocessor

#Import DocumentManager and transactionmanager
clr.AddReference("RevitServices")
from RevitServices.Persistence import DocumentManager
from RevitServices.Transactions import TransactionManager

#Assign input to variables
levels = int(IN[0])
height = IN[1]
floorType = UnwrapElement(IN[2])
clear = IN[3]
allElements = UnwrapElement(IN[4])
level = UnwrapElement(IN[5])
wallType = UnwrapElement(IN[6])
lengthX = IN[7]
lengthY = IN[8]
utilizationUnits = int(IN[9])
basement = IN[10]
basementCeiling = UnwrapElement(IN[11])

#Create output lists
output = []
wallList = []
levelList = []
floorList = []

#Convert units to meters
H = UnitUtils.ConvertToInternalUnits(height, DisplayUnitType.DUT_METERS)
revitApiX = UnitUtils.ConvertToInternalUnits(lengthX, DisplayUnitType.DUT_METERS)
revitApiY = UnitUtils.ConvertToInternalUnits(lengthY, DisplayUnitType.DUT_METERS)

#Open document and start transaction
doc = DocumentManager.Instance.CurrentDBDocument
TransactionManager.Instance.EnsureInTransaction(doc)

#Clear previous generated elements
levelArray = (FilteredElementCollector(doc)
    .OfCategory(BuiltInCategory.OST_Levels)
    .WhereElementIsNotElementType()
    .ToElements())

if levelArray.Count > 1:
    for levelElement in levelArray:
        if levelElement.Elevation != 0:
            doc.Delete(levelElement.Id)

if clear:
    for element in allElements:
        doc.Delete(element.Id)

levelList.append(level)

#Create corner points
x = [0, revitApiX, revitApiX, 0]
y = [0, 0, revitApiY, revitApiY]

points = []

point0 = XYZ(x[0], y[0], 0)
points.append(point0)
point1 = XYZ(x[1], y[1], 0)
points.append(point1)
point2 = XYZ(x[2], y[2], 0)
points.append(point2)
point3 = XYZ(x[3], y[3], 0)
points.append(point3)

#Create basement level, walls, and floor
if basement:
    basementLevel = Autodesk.Revit.DB.Level.Create(doc, (-1) * H)
    basementLevel.Name = "Level -1"
    
    lines = []

    line1 = Autodesk.Revit.DB.Line.CreateBound(
        XYZ(points[0].X, points[0].Y, (-1) * H),
        XYZ(points[1].X, points[1].Y, (-1) * H))
    line2 = Autodesk.Revit.DB.Line.CreateBound(
        XYZ(points[1].X, points[1].Y, (-1) * H),
        XYZ(points[2].X, points[2].Y, (-1) * H))
    line3 = Autodesk.Revit.DB.Line.CreateBound(
        XYZ(points[2].X, points[2].Y, (-1) * H),
        XYZ(points[3].X, points[3].Y, (-1) * H))
    line4 = Autodesk.Revit.DB.Line.CreateBound(
        XYZ(points[3].X, points[3].Y, (-1) * H),
        XYZ(points[0].X, points[0].Y, (-1) * H))

    lines.append(line1)
    lines.append(line2)
    lines.append(line3)
    lines.append(line4)
    
    curveArray = CurveArray()
    
    for line in lines:
        wall = Wall.Create(doc, line, wallType.Id, basementLevel.Id, H, 0, False, True)
        wallList.append(wall.ToDSType(False))
        curveArray.Append(line)
        
    floor = doc.Create.NewFloor(curveArray, floorType, basementLevel, True)
    floorList.append(floor.ToDSType(False))

#Create outer walls
lines = []

line1 = Autodesk.Revit.DB.Line.CreateBound(points[0], points[1])
line2 = Autodesk.Revit.DB.Line.CreateBound(points[1], points[2])
line3 = Autodesk.Revit.DB.Line.CreateBound(points[2], points[3])
line4 = Autodesk.Revit.DB.Line.CreateBound(points[3], points[0])

lines.append(line1)
lines.append(line2)
lines.append(line3)
lines.append(line4)
    
for line in lines:
    wall = Wall.Create(doc, line, wallType.Id, level.Id, levels * H, 0, False, True)
    wallList.append(wall.ToDSType(False))
    
#Create ground level floor or basement ceiling
lines = []

line1 = Autodesk.Revit.DB.Line.CreateBound(points[0], points[1])
line2 = Autodesk.Revit.DB.Line.CreateBound(points[1], points[2])
line3 = Autodesk.Revit.DB.Line.CreateBound(points[2], points[3])
line4 = Autodesk.Revit.DB.Line.CreateBound(points[3], points[0])

lines.append(line1)
lines.append(line2)
lines.append(line3)
lines.append(line4)

curveArray = CurveArray()

curveArray.Append(line1)
curveArray.Append(line2)
curveArray.Append(line3)
curveArray.Append(line4)

if basement:
    floor = doc.Create.NewFloor(curveArray, basementCeiling, level, True)
else:
    floor = doc.Create.NewFloor(curveArray, floorType, level, True)
    
floorList.append(floor.ToDSType(False))

#Create levels and floors above ground
if levels >= 1:
    for levelNumber in range(1, levels + 1):
        newLevel = Autodesk.Revit.DB.Level.Create(doc, levelNumber * H)
        levelList.append(newLevel)
        
        line1 = Autodesk.Revit.DB.Line.CreateBound(
            XYZ(points[0].X, points[1].Y,  levelNumber * H),
            XYZ(points[1].X, points[1].Y, levelNumber * H))
        line2 = Autodesk.Revit.DB.Line.CreateBound(
            XYZ(points[1].X, points[1].Y, levelNumber * H),
            XYZ(points[2].X, points[2].Y, levelNumber * H))
        line3 = Autodesk.Revit.DB.Line.CreateBound(
            XYZ(points[2].X, points[2].Y, levelNumber * H),
            XYZ(points[3].X, points[3].Y, levelNumber * H))
        line4 = Autodesk.Revit.DB.Line.CreateBound(
            XYZ(points[3].X, points[3].Y, levelNumber * H),
            XYZ(points[0].X, points[0].Y, levelNumber * H))
        
        curveArray = CurveArray()
        curveArray.Append(line1)
        curveArray.Append(line2)
        curveArray.Append(line3)
        curveArray.Append(line4)
        
        floor = doc.Create.NewFloor(curveArray, floorType, newLevel, True)
        floorList.append(floor.ToDSType(False))

        newLevel.Name = "Level " + str(levelNumber + 1)
        
#Create inner walls to seperate utilization units
utilizationUnitsPerLevel = list(range(levels))

for i in range(levels):
    utilizationUnitsPerLevel[i] = int(math.floor(utilizationUnits / levels))
    
remainder = utilizationUnits - utilizationUnitsPerLevel[0] * levels

j = 0

while j < remainder:
    utilizationUnitsPerLevel[j] = utilizationUnitsPerLevel[j] + 1
    j = j + 1

for m in range(levels):
    for n in range(1, utilizationUnitsPerLevel[m]):
        utilizationUnitLine = Autodesk.Revit.DB.Line.CreateBound(
            XYZ((revitApiX / utilizationUnitsPerLevel[m]) * n, revitApiY, H * m),
            XYZ((revitApiX / utilizationUnitsPerLevel[m]) * n, 0, H * m))
        wall = Wall.Create(doc, utilizationUnitLine, wallType.Id, levelList[m].Id, H, 0, False, True)
        wallList.append(wall.ToDSType(False))

#End transaction and output levels, floors, walls
TransactionManager.Instance.TransactionTaskDone()

output.append(levelList)
output.append(floorList)
output.append(wallList)
OUT = output
# ----------------------------------------

# group: Building Class Control
building_class_node = Python(IN[0]=x_m, IN[1]=y_m, IN[2]=levels, IN[3]=levelheight_m, IN[4]=utilizationUnits, IN[5]=freestanding, IN[6]=agricultural_forestry)
# ---------- building_class_node.python (40 lines) ----------
#Load the Python Standard and DesignScript Libraries and Math
import sys
import clr
clr.AddReference('ProtoGeometry')
from Autodesk.DesignScript.Geometry import *
import math

#Assign input to variables
x = IN[0]
y = IN[1]
levels = IN[2]
levelHeight = IN[3]
units = IN[4]
freestanding = IN[5]
agricultureforestry = IN[6]

#Calculate building height and gross floor area
area = int(x * y * levels)
height = int((levels - 1) * levelHeight)

#Determine and output building class
if not agricultureforestry:
	if height <= 7:
		if area <= 400 and units <= 2:
			if freestanding:
				buildingClass = "Building Class 1"
			else:
				buildingClass = "Building Class 2"
		else:
			buildingClass = "Building Class 3"
	else:
		if (height <= 13
		and (x * y / math.floor(units / levels)) <= 400):
			buildingClass = "Building Class 4"
		else:
			buildingClass = "Building Class 5"
else:
	buildingClass = "Building Class 1"

OUT = buildingClass
# ----------------------------------------
building_class = Watch(building_class_node)

# group: Errors
error_detection = Python(IN[0]=building_class_to_integer, IN[1]=freestanding, IN[2]=agricultural_forestry)
# ---------- error_detection.python (16 lines) ----------
#Load the Python Standard and DesignScript Libraries
import sys
import clr
clr.AddReference('ProtoGeometry')
from Autodesk.DesignScript.Geometry import *

#Assign input to variables
buildingClass = IN[0]
freestanding = IN[1]
agricultureforestry = IN[2]

#Check for error with building class 1 parameters and output report
if buildingClass == 1 and not freestanding and not agricultureforestry:
	OUT = "Building must be freestanding\nor agricultural/forestry"
else:
	OUT = "no error"
# ----------------------------------------
error_report = Watch(error_detection)
